# Grasshopper definition ParametricModel.gh (Grasshopper 1.0.7)
# plug-ins: LunchBox, GH_CPython

ladybug = Ladybug_Ladybug()  # -> Vviiiiiiiiiizzz; plug-in component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

# ----
# Input
# Ranges
panel = Panel("20")
xbui = Panel("""15
20
25
30""")
height = Panel("""2.4
2.6
2.8
3.0
3.2
3.4
3.6
3.8
4.0""")
glzratio = Panel("""0.3
0.4
0.5
0.6
0.7""")
series = Series(Start=0, Step=1, Count=panel)
ybui = Panel("""15
20
25
30""")
nroom = Panel("""2
3
4
5
6
7
8
9
10""")

honeybee = Honeybee_Honeybee()  # -> Vviiiiiiiiiizzz; plug-in component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

# ----
# Getting a stratified sample
# out of the whole design space
# Features - Full names: Width
# Length
# Floor Height
# Number of Rooms
# Seed
# Glazing Ratio
crossref = CrossReference(ListA=xbui, ListB=ybui, ListC=height, ListD=nroom, ListE=series, ListF=glzratio, CrossMode=1)  # -> ListA, ListB, ListC, ListD, ListE, ListF
features = Panel("""xBUI
yBUI
FH
nRoom
nSeed
GlzRatio""")
merge = Merge(
    Data1=crossref.ListA,
    Data2=crossref.ListB,
    Data3=crossref.ListC,
    Data4=crossref.ListD,
    Data5=crossref.ListE,
    Data6=crossref.ListF)
gh_cpython = GH_CPython(
    directory="F:\your\folder\here",
    features=features,
    stratifyBy_idx=Slider(1, range=0..1),
    input=merge,
    percentage=Slider(0.05, range=0..0.1))  # -> csv; inputs directory: list, features: list, stratifyBy_idx: list, input: list, percentage: list
#   port csv: indicate your output description here. refers to a new line.
# ---------- gh_cpython: Python ----------
import numpy as np
import pandas as pd

data = np.asarray(_input)
data = np.split(data, len(_features))
data = np.stack(data, axis=1)
df = pd.DataFrame(data, columns=_features)

from sklearn.model_selection import train_test_split

#stratify according to a feature
X = df
y = df[_features[_stratifyBy_idx]]

X_train, X_test, y_train, y_test = train_test_split(X, y, test_size=percentage, random_state=42)
idx = X_test.index

stratified_ = df.iloc[idx, :]
print(stratified_.shape)
csv = directory + '\stratified_ds.csv'
pd.DataFrame.to_csv(stratified_, csv, sep=',', index=False)
# ---------- end gh_cpython ----------
csv = ReadCSV(CSVString=gh_cpython, Delimiter=",")  # -> Headers, Values
parameters = Panel(csv.Headers)
bang = ExplodeTree(Data=csv.Values)  # -> Branch0, Branch1, Branch2, Branch3, Branch4, Branch5

lng = ListLength(List=bang.Branch1)
total_number_of_cases = Panel(lng)

# ----
# Run all cases
number_slider = Slider(42, range=0..42)
fly = Ladybug_fly(inputSliders=number_slider, fly=Toggle(False))  # -> Vviiiiiiiiiizzz; plug-in component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

item = ListItem(List=bang.Branch2, Index=number_slider, Wrap=True)
item_2 = ListItem(List=bang.Branch0, Index=number_slider, Wrap=True)
item_3 = ListItem(List=bang.Branch1, Index=number_slider, Wrap=True)
item_4 = ListItem(List=bang.Branch3, Index=number_slider, Wrap=True)
item_5 = ListItem(List=bang.Branch4, Index=number_slider, Wrap=True)
item_6 = ListItem(List=bang.Branch5, Index=number_slider, Wrap=True)

python_script = PythonScript(xBUI=item_2, yBUI=item_3, nROOM=item_4, Height=item, Seed=item_5)  # -> out, Rooms, RoomFR; inputs nROOM: Int32, Height: Int32
# ---------- python_script: Python ----------
import ghpythonlib.components as ghcomp
import math


Frame = ghcomp.Rectangle2Pt(ghcomp.XYPlane(), ghcomp.ConstructPoint(), ghcomp.ConstructPoint(xBUI, yBUI,0))[0]
ptPOP = ghcomp.Populate2D(Frame, nROOM, Seed)
RoomFR = ghcomp.QuadTree(ptPOP, ghcomp.XYPlane(), False, 0)[0]
Rooms = ghcomp.Extrude(RoomFR, ghcomp.UnitZ(Height))
Rooms = ghcomp.CapHoles(Rooms)
# ---------- end python_script ----------
boundary = BoundarySurfaces(Edges=python_script.RoomFR)
Z = UnitZ(Factor=item)
extr = Extrude(Base=boundary, Direction=Z)
brep_wireframe = BrepWireframe(Brep=extr, Density=-1)

# ----
# Generate
# Case Name
int = Integer(item_2)  # disabled
int_2 = Integer(item_4)  # disabled
int_3 = Integer(item_3)  # disabled
int_4 = Integer(item_5)  # disabled
panel_2 = Panel("xBUI_")  # disabled
panel_3 = Panel("_GlzRatio_")  # disabled
panel_4 = Panel("_nROOM_")  # disabled
panel_5 = Panel("_Seed_")  # disabled
panel_6 = Panel("_yBUI_")  # disabled
panel_7 = Panel("_Height_")  # disabled
concat = Concatenate(
    FragmentA=panel_2,
    FragmentB=int,
    FragmentC=panel_6,
    FragmentD=int_3,
    FragmentE=panel_4,
    FragmentF=int_2,
    FragmentG=panel_7,
    FragmentH=item,
    FragmentI=panel_5,
    FragmentJ=int_4,
    FragmentK=panel_3,
    FragmentL=item_6)  # disabled
panel_8 = Panel(concat)  # disabled

# ----
# Generate
# Geometry
cluster = Cluster(C=python_script.RoomFR, num=item)  # -> G_2, S, R_4, G_4, R_5, panel_10, G, R_2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

# ----
# Generate HB
# Analysis Grid
number_slider_2 = Slider(0.01, range=0..1)  # disabled
number_slider_3 = Slider(0.25, range=0..1)  # disabled
gentestpts = Honeybee_GenerateTestPoints(testGeometry=flatten(cluster.G_2), gridSize=number_slider_3, distBaseSrf=number_slider_2, moveTestMesh=True)  # -> readMe, simplify(flatten(testPoints)), simplify(flatten(ptsVectors)), simplify(facesArea), simplify(mesh); disabled; plug-in component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
panel_9 = Panel("Floor")  # disabled
analysisgrid = HoneybeePlus_AnalysisGrid(name=panel_9, test_points=gentestpts.testPoints)  # -> analysis_grid; disabled; plug-in component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

# ----
# Generate
# HB Geometries
panel_10 = Panel("2")  # disabled
panel_11 = Panel("1")  # disabled
panel_12 = Panel("0")  # disabled
hbwinsrf = HoneybeePlus_HoneybeeWindowSurface(geo=cluster.R_3)  # -> report, HB_win_srf; disabled; plug-in component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
hbsurface = HoneybeePlus_HoneybeeSurface(geo=[cluster.R_4, cluster.R_5], type=panel_12)  # -> report, HB_srf; disabled; plug-in component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
hbsurface_2 = HoneybeePlus_HoneybeeSurface(geo=cluster.G, type=panel_11)  # -> report, HB_srf; disabled; plug-in component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
hbsurface_3 = HoneybeePlus_HoneybeeSurface(geo=cluster.S, type=panel_10)  # -> report, HB_srf; disabled; plug-in component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

# ----
# Save JSON
# files
panel_13 = Panel("F:\ML\CaseStudies\IndoorGAN\JSONs\grids\")  # disabled
panel_14 = Panel("F:\ML\CaseStudies\IndoorGAN\JSONs\surfaces\")  # disabled
python = GhPythonScript(
    surfaces=flatten([hbsurface.HB_srf, hbsurface_2.HB_srf, hbsurface_3.HB_srf, hbwinsrf.HB_win_srf]),
    filePath=panel_14,
    fileName=panel_8)  # -> out, a; inputs surfaces: list; disabled
# ---------- python: Python ----------
from honeybee.hbsurface import HBSurface
import json

json_srf = [str(srf.to_json()) for srf in surfaces]

with open(filePath+fileName+'.json', 'w') as json_file:
    json.dump(json_srf, json_file)
# ---------- end python ----------
python_2 = GhPythonScript(grid=analysisgrid, filePath=panel_13, fileName=panel_8)  # -> out, a; disabled
# ---------- python_2: Python ----------
from honeybee.radiance.analysisgrid import AnalysisGrid
import json

json_grid = AnalysisGrid.to_json(grid)

with open(filePath+fileName+'.json', 'w') as json_file:
    json.dump(json_grid, json_file)
# ---------- end python_2 ----------

# ----
# Generate
# Color Gradient
panel_15 = Panel("2")  # disabled
panel_16 = Panel("4")  # disabled
gradient = Gradient(
    LowerLimit=cluster.panel_10,
    UpperLimit=cluster.R,
    Parameter=cluster.R_2,
    stops=[0: RGB(234, 38, 0), 0.25: RGB(234, 126, 0), 0.5: RGB(254, 244, 84), 0.75: RGB(173, 203, 249), 1: RGB(75, 107, 169)])  # disabled
preview = CustomPreview(Geometry=cluster.G_3, Shader=gradient)  # disabled

gradient_2 = Gradient(LowerLimit=panel_15, UpperLimit=panel_16, Parameter=cluster.num_3, stops=[0: RGB(255, 255, 255), 1: RGB(0, 0, 0)])  # disabled

preview_2 = CustomPreview(Geometry=flatten(cluster.G_4), Shader=gradient_2)  # disabled

# ==== cluster Cluster
C = ClusterInput()
num = ClusterInput()
runion = RegionUnion(Curves=C)  # disabled
number_slider = Slider(446, range=0..1000)  # disabled
panel = Panel("0.15")  # disabled
explode = Explode(Curve=runion, Recursive=True)  # -> Segments, Vertices; disabled
num_2 = Number(num)  # disabled
num_3 = ClusterOutput(num_2)
ext = ExtendCurve(Curve=explode.Segments, Type=0, Start=panel, End=panel)  # disabled
panel_2 = Panel("42")  # disabled
addition = Addition(A=number_slider, B=panel_2)  # disabled
panel_3 = Panel("0.1")  # disabled
panel_4 = Panel("0.4")  # disabled
panel_5 = Panel("0.1")  # disabled
panel_6 = Panel("0.45")  # disabled
panel_7 = Panel("0.55")  # disabled
panel_8 = Panel("0.9")  # disabled
dom = ConstructDomain(DomainStart=panel_5, DomainEnd=panel_6)  # disabled
lng = ListLength(List=ext)  # disabled
subtraction = Subtraction(A=num_2, B=panel_3, C=panel_4)  # disabled
R = ClusterOutput(subtraction)
dom_2 = ConstructDomain(DomainStart=panel_7, DomainEnd=panel_8)  # disabled
lng_2 = ListLength(List=ext)  # disabled
panel_9 = Panel("1")  # disabled
panel_10 = ClusterOutput(panel_9)
dom_3 = ConstructDomain(DomainStart=panel_9, DomainEnd=subtraction)  # disabled
lng_3 = ListLength(List=ext)  # disabled
random = Random(Range=dom, Number=lng, Seed=number_slider)  # disabled
random_2 = Random(Range=dom_2, Number=lng_2, Seed=addition)  # disabled
random_3 = Random(Range=dom_3, Number=lng_3, Seed=addition)  # disabled
R_2 = ClusterOutput(random_3)
eval = EvaluateLength(Curve=ext, Length=random, Normalized=True)  # -> Point, Tangent, Parameter; disabled
eval_2 = EvaluateLength(Curve=ext, Length=random_2, Normalized=True)  # -> Point, Tangent, Parameter; disabled
panel_11 = Panel("1")  # disabled
Z = UnitZ(Factor=panel_4)  # disabled
roundd = RoundToDecimalPlace(NumberX=random_3, DecimalPlace=panel_11, RoundType=0)  # -> Rounded, Difference; disabled
ln = Line(StartPoint=eval.Point, EndPoint=eval_2.Point)  # disabled
Z_2 = UnitZ(Factor=roundd.Rounded)  # disabled
move = Move(Geometry=ln, Motion=Z)  # -> Geometry, Transform; disabled
extr = Extrude(Base=move.Geometry, Direction=Z_2)  # disabled
Z_3 = UnitZ(Factor=num_2)  # disabled
debrep = DeconstructBrep(Brep=extr)  # -> Faces, Edges, Vertices; disabled
join = JoinCurves(Curves=flatten(debrep.Edges), Preserve=False)  # disabled
Z_4 = UnitZ(Factor=Z_3)  # disabled
neg = Negative(Value=panel)  # disabled
extr_2 = Extrude(Base=ext, Direction=Z_4)  # disabled
offset = OffsetCurve(Curve=runion, Distance=neg, Plane=PlaneXY(0, 0, 0), Corners=1)  # disabled
srfsplit = SurfaceSplit(Surface=graft(extr_2), Curves=graft(join))  # disabled
boundary = BoundarySurfaces(Edges=offset)  # disabled
S = ClusterOutput(boundary)
panel_12 = Panel("1")  # disabled
panel_13 = Panel("0")  # disabled
panel_14 = Panel("0.1")  # disabled
item = ListItem(List=srfsplit, Index=panel_12, Wrap=True)  # disabled
move_2 = Move(Geometry=boundary, Motion=Z_3)  # -> Geometry, Transform; disabled
G = ClusterOutput(move_2.Geometry)
item_2 = ListItem(List=srfsplit, Index=panel_13, Wrap=True)  # disabled
Z_5 = UnitZ(Factor=panel_14)  # disabled
debrep_2 = DeconstructBrep(Brep=item)  # -> Faces, Edges, Vertices; disabled
debrep_3 = DeconstructBrep(Brep=item_2)  # -> Faces, Edges, Vertices; disabled
move_3 = Move(Geometry=boundary, Motion=Z_5)  # -> Geometry, Transform; disabled
G_2 = ClusterOutput(move_3.Geometry)
crv = Curve(debrep_2.Edges)  # disabled
crv_2 = Curve(debrep_3.Edges)  # disabled
boundary_2 = BoundarySurfaces(Edges=crv)  # disabled
join_2 = JoinCurves(Curves=crv_2, Preserve=False)  # disabled
area = Area(Geometry=boundary_2)  # -> Area, Centroid; disabled
evalsrf = EvaluateSurface(Surface=boundary_2, Point=area.Centroid)  # -> Point, Normal, UDirection, VDirection, Frame; disabled
panel_15 = Panel("0.075")  # disabled
multiplication = Multiplication(A=evalsrf.Normal, B=panel_15)  # disabled
multiplication_2 = Multiplication(A=evalsrf.Normal, B=panel)  # disabled
rev = Reverse(Vector=multiplication_2)  # disabled
rev_2 = Reverse(Vector=multiplication)  # disabled
extr_3 = Extrude(Base=debrep_3.Faces, Direction=multiplication_2)  # -> flatten(Extrusion); disabled
extr_4 = Extrude(Base=debrep_2.Faces, Direction=multiplication)  # disabled
extr_5 = Extrude(Base=debrep_3.Faces, Direction=rev)  # -> flatten(Extrusion); disabled
extr_6 = Extrude(Base=debrep_2.Faces, Direction=rev_2)  # disabled
sunion = SolidUnion(Breps=flatten([extr_4, extr_6]))  # disabled
R_3 = ClusterOutput(sunion)
sunion_2 = SolidUnion(Breps=flatten(extr_3))  # disabled
R_4 = ClusterOutput(sunion_2)
sunion_3 = SolidUnion(Breps=flatten(extr_5))  # disabled
R_5 = ClusterOutput(sunion_3)
panel_16 = Panel("0.3")  # disabled
panel_17 = Panel("0.1")  # disabled
scale_nu = ScaleNU(Geometry=sunion, Plane=PlaneXY(0, 0, 0), ScaleX=1, ScaleY=1, ScaleZ=panel_16)  # -> Geometry, Transform; disabled
G_3 = ClusterOutput(scale_nu.Geometry)
scale_nu_2 = ScaleNU(Geometry=[sunion_2, sunion_3], Plane=PlaneXY(0, 0, 0), ScaleX=1, ScaleY=1, ScaleZ=panel_17)  # -> Geometry, Transform; disabled
G_4 = ClusterOutput(scale_nu_2.Geometry)
