# Grasshopper definition PostProcessing.gh (Grasshopper 1.0.7)
# plug-ins: GH_CPython

ladybug = Ladybug_Ladybug()  # -> Vviiiiiiiiiizzz; plug-in component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

# ----
# Load Radiance
# Results
number_slider = Slider(0, range=0..1401)
panel = Panel("""CDA
DA
UDI
UDI_more
UDI_less""")
gh_cpython = GH_CPython(analysisTypes=panel, analysisFolder="Your\Folder\Here", caseID=number_slider)  # -> parameter_names, parameter_values, CDA, DA, UDI, UDI_more, UDI_less, fileName; inputs analysisTypes: list, analysisFolder: list, caseID: list
#   port analysisTypes: [required] - [type = int] - [default = None] Descripe your input here * bullet point. * bullet point
#   port CDA: indicate your output description here. refers to a new line.
# ---------- gh_cpython: Python ----------
import numpy as np
import glob
import os

folder = _analysisFolder


if 'CDA' in analysisTypes:
    cda_files = glob.glob(folder + 'CDA' + '\*.npy', recursive=False)
    cda_files.sort(key=lambda x: os.path.getmtime(x))
    req_cda = list(np.load(cda_files[caseID]))
if 'DA' in analysisTypes:
    da_files = glob.glob(folder + 'DA' + '\*.npy', recursive=False)
    da_files.sort(key=lambda x: os.path.getmtime(x))
    req_da = list(np.load(da_files[caseID]))
if 'UDI' in analysisTypes:
    udi_files = glob.glob(folder + 'UDI' + '\*.npy', recursive=False)
    udi_files.sort(key=lambda x: os.path.getmtime(x))
    req_udi = list(np.load(udi_files[caseID]))
if 'UDI_more' in analysisTypes:
    udi_more_files = glob.glob(folder + 'UDI_more' + '\*.npy', recursive=False)
    udi_more_files.sort(key=lambda x: os.path.getmtime(x))
    req_udi_more = list(np.load(udi_more_files[caseID]))
if 'UDI_less' in analysisTypes:
    udi_less_files = glob.glob(folder + 'UDI_less' + '\*.npy', recursive=False)
    udi_less_files.sort(key=lambda x: os.path.getmtime(x))
    req_udi_less = list(np.load(udi_less_files[caseID]))

CDA = req_cda
DA = req_da
UDI = req_udi
UDI_more = req_udi_more
UDI_less = req_udi_less

parameter_names = list(np.asarray(da_files[caseID].split('\\')[-1][:-4].split('_')[::2]))
parameter_values = list(np.asarray(da_files[caseID].split('\\')[-1][:-4].split('_')[::-2]).astype('float'))

fileName = cda_files[caseID].split('\\')[-1][:-4]

print(len(cda_files))
# ---------- end gh_cpython ----------
data = Data(graft(gh_cpython.parameter_values))
bang = ExplodeTree(Data=data)  # -> Branch0, Branch1, Branch2, Branch3, Branch4, Branch5

honeybee = Honeybee_Honeybee()  # -> Vviiiiiiiiiizzz; plug-in component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

# ----
# Run all cases
toggle = BooleanToggle(False)
fly = Ladybug_fly(inputSliders=number_slider, fly=toggle)  # -> Vviiiiiiiiiizzz; plug-in component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

# ----
# Generate Geometry
python_script = PythonScript(xBUI=bang.Branch5, yBUI=bang.Branch4, nROOM=bang.Branch3, Height=bang.Branch2, Seed=bang.Branch1)  # -> out, Rooms, RoomFR; inputs nROOM: Int32, Height: Int32
# ---------- python_script: Python ----------
import ghpythonlib.components as ghcomp
import math


Frame = ghcomp.Rectangle2Pt(ghcomp.XYPlane(), ghcomp.ConstructPoint(), ghcomp.ConstructPoint(xBUI, yBUI,0))[0]
ptPOP = ghcomp.Populate2D(Frame, nROOM, Seed)
RoomFR = ghcomp.QuadTree(ptPOP, ghcomp.XYPlane(), False, 0)[0]
Rooms = ghcomp.Extrude(RoomFR, ghcomp.UnitZ(Height))
Rooms = ghcomp.CapHoles(Rooms)
# ---------- end python_script ----------
boundary = BoundarySurfaces(Edges=python_script.RoomFR)
Z = UnitZ(Factor=bang.Branch2)
extr = Extrude(Base=boundary, Direction=Z)
brep_wireframe = BrepWireframe(Brep=extr, Density=-1)
cluster = Cluster(C=python_script.RoomFR, num=bang.Branch2)  # -> G, G_2, panel, R_2, num_3, R, E

# ----
# Create grids
number_slider_2 = Slider(0.01, range=0..1)
gentestpts = Honeybee_GenerateTestPoints(testGeometry=flatten(cluster.G), gridSize=Slider(0.25, range=0..1), distBaseSrf=number_slider_2, moveTestMesh=True)  # -> readMe, simplify(flatten(testPoints)), simplify(flatten(ptsVectors)), simplify(facesArea), simplify(mesh); plug-in component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
mjoin = MeshJoin(Meshes=flatten(gentestpts.mesh))

# ----
# Create
# Gradients
panel_2 = Panel("2")
gradient = Gradient(LowerLimit=panel_2, UpperLimit="4", Parameter=cluster.num_3, stops=[0: RGB(255, 255, 255), 1: RGB(0, 0, 0)])
gradient_2 = Gradient(
    LowerLimit=cluster.panel,
    UpperLimit=cluster.R,
    Parameter=cluster.R_2,
    stops=[0: RGB(234, 38, 0), 0.25: RGB(234, 126, 0), 0.5: RGB(254, 244, 84), 0.75: RGB(173, 203, 249), 1: RGB(75, 107, 169)])
mcol = MeshColours(Mesh=cluster.G_2, Colours=gradient)
preview = CustomPreview(Geometry=cluster.E, Shader=flatten(gradient_2))

# ----
# Ladybug LegendPar
number_slider_3 = Slider(1, range=0..100)
gradientlibrary = Ladybug_GradientLibrary(gradIndex=number_slider_3)  # -> customColors; plug-in component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
gradientlibrary_2 = Ladybug_GradientLibrary(gradIndex=Slider(1, range=0..100))  # -> customColors; plug-in component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
rev = ReverseList(List=gradientlibrary)
legendpar = Ladybug_LegendParameters(lowBound=Slider(0, range=0..100), highBound=Slider(100, range=0..100), customColors=flatten(rev))  # -> legendPar; plug-in component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
legendpar_2 = Ladybug_LegendParameters(lowBound=Slider(0, range=0..100), highBound=Slider(100, range=0..100), customColors=flatten(gradientlibrary_2))  # -> legendPar; plug-in component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

recolormesh = Ladybug_RecolorMesh(analysisResult=gh_cpython.DA, inputMesh=mjoin, legendPar=legendpar)  # -> readMe, newMesh, newLegend, legendBasePt, meshColors, legendColors; plug-in component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
mesh = Mesh(recolormesh.newMesh)

recolormesh_2 = Ladybug_RecolorMesh(analysisResult=gh_cpython.UDI, inputMesh=mjoin, legendPar=legendpar)  # -> readMe, newMesh, newLegend, legendBasePt, meshColors, legendColors; plug-in component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
mesh_2 = Mesh(recolormesh_2.newMesh)

recolormesh_3 = Ladybug_RecolorMesh(analysisResult=gh_cpython.CDA, inputMesh=mjoin, legendPar=legendpar)  # -> readMe, newMesh, newLegend, legendBasePt, meshColors, legendColors; plug-in component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
mesh_3 = Mesh(recolormesh_3.newMesh)

recolormesh_4 = Ladybug_RecolorMesh(analysisResult=gh_cpython.UDI_more, inputMesh=mjoin, legendPar=legendpar_2)  # -> readMe, newMesh, newLegend, legendBasePt, meshColors, legendColors; plug-in component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
mesh_4 = Mesh(recolormesh_4.newMesh)

recolormesh_5 = Ladybug_RecolorMesh(analysisResult=gh_cpython.UDI_less, inputMesh=mjoin, legendPar=legendpar_2)  # -> readMe, newMesh, newLegend, legendBasePt, meshColors, legendColors; plug-in component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
# Plot Results and
# arrange accordingly
mesh_5 = Mesh(recolormesh_5.newMesh)

pt = Point(Point(120, 0, 0))
move = Move(Geometry=cluster.G_2, Motion=pt)  # -> Geometry, Transform
move_2 = Move(Geometry=cluster.E, Motion=pt)  # -> Geometry, Transform
move_3 = Move(Geometry=mesh_2, Motion=pt)  # -> Geometry, Transform
mcol_2 = MeshColours(Mesh=move.Geometry, Colours=gradient)
preview_2 = CustomPreview(Geometry=move_2.Geometry, Shader=flatten(gradient_2))

pt_2 = Point(Point(240, 0, 0))
move_4 = Move(Geometry=cluster.G_2, Motion=pt_2)  # -> Geometry, Transform
move_5 = Move(Geometry=cluster.E, Motion=pt_2)  # -> Geometry, Transform
move_6 = Move(Geometry=mesh_3, Motion=pt_2)  # -> Geometry, Transform
mcol_3 = MeshColours(Mesh=move_4.Geometry, Colours=gradient)
preview_3 = CustomPreview(Geometry=move_5.Geometry, Shader=flatten(gradient_2))

pt_3 = Point(Point(360, 0, 0))
move_7 = Move(Geometry=cluster.G_2, Motion=pt_3)  # -> Geometry, Transform
move_8 = Move(Geometry=cluster.E, Motion=pt_3)  # -> Geometry, Transform
move_9 = Move(Geometry=mesh_4, Motion=pt_3)  # -> Geometry, Transform
mcol_4 = MeshColours(Mesh=move_7.Geometry, Colours=gradient)
preview_4 = CustomPreview(Geometry=move_8.Geometry, Shader=flatten(gradient_2))

pt_4 = Point(Point(480, 0, 0))
move_10 = Move(Geometry=cluster.G_2, Motion=pt_4)  # -> Geometry, Transform
move_11 = Move(Geometry=cluster.E, Motion=pt_4)  # -> Geometry, Transform
move_12 = Move(Geometry=mesh_5, Motion=pt_4)  # -> Geometry, Transform
mcol_5 = MeshColours(Mesh=move_10.Geometry, Colours=gradient)
preview_5 = CustomPreview(Geometry=move_11.Geometry, Shader=flatten(gradient_2))

# ----
# Generate Images
number_slider_4 = Slider(2048, range=0..10000)
panel_3 = Panel("""UDI
DA
CDA
UDI_more
UDI_less""")
captureview = Ladybug_CaptureView(
    fileName=gh_cpython.fileName,
    folder="Your\folder\here",
    viewNames=panel_3,
    imageWidth=number_slider_4,
    imageHeight=number_slider_4,
    capture=Toggle(False))  # -> imagePath; plug-in component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

# ==== cluster Cluster
C = ClusterInput()
num = ClusterInput()
runion = RegionUnion(Curves=C)
number_slider = Slider(446, range=0..1000)
explode = Explode(Curve=runion, Recursive=True)  # -> Segments, Vertices
ext = ExtendCurve(Curve=explode.Segments, Type=0, Start="0.15", End="0.15")
num_2 = Number(num)
num_3 = ClusterOutput(num_2)
addition = Addition(A=number_slider, B="42")
dom = ConstructDomain(DomainStart="0.1", DomainEnd="0.45")
lng = ListLength(List=ext)
subtraction = Subtraction(A=num_2, B="0.1", C="0.4")
R = ClusterOutput(subtraction)
dom_2 = ConstructDomain(DomainStart="0.55", DomainEnd="0.9")
lng_2 = ListLength(List=ext)
panel = ClusterOutput("1")
dom_3 = ConstructDomain(DomainStart="1", DomainEnd=subtraction)
lng_3 = ListLength(List=ext)
random = Random(Range=dom, Number=lng, Seed=number_slider)
random_2 = Random(Range=dom_2, Number=lng_2, Seed=addition)
random_3 = Random(Range=dom_3, Number=lng_3, Seed=addition)
R_2 = ClusterOutput(random_3)
eval = EvaluateLength(Curve=ext, Length=random, Normalized=True)  # -> Point, Tangent, Parameter
eval_2 = EvaluateLength(Curve=ext, Length=random_2, Normalized=True)  # -> Point, Tangent, Parameter
Z = UnitZ(Factor="0.4")
Z_2 = UnitZ(Factor=random_3)
ln = Line(StartPoint=eval.Point, EndPoint=eval_2.Point)
move = Move(Geometry=ln, Motion=Z)  # -> Geometry, Transform
extr = Extrude(Base=move.Geometry, Direction=Z_2)
debrep = DeconstructBrep(Brep=extr)  # -> Faces, Edges, Vertices
join = JoinCurves(Curves=flatten(debrep.Edges), Preserve=False)
Z_3 = UnitZ(Factor=num_2)
neg = Negative(Value="0.15")
extr_2 = Extrude(Base=ext, Direction=Z_3)
offset = OffsetCurve(Curve=runion, Distance=neg, Plane=PlaneXY(0, 0, 0), Corners=1)
srfsplit = SurfaceSplit(Surface=graft(extr_2), Curves=graft(join))
boundary = BoundarySurfaces(Edges=offset)
item = ListItem(List=srfsplit, Index="1", Wrap=True)
item_2 = ListItem(List=srfsplit, Index="0", Wrap=True)
Z_4 = UnitZ(Factor="0.1")
debrep_2 = DeconstructBrep(Brep=item)  # -> Faces, Edges, Vertices
debrep_3 = DeconstructBrep(Brep=item_2)  # -> Faces, Edges, Vertices
move_2 = Move(Geometry=boundary, Motion=Z_4)  # -> Geometry, Transform
G = ClusterOutput(move_2.Geometry)
crv = Curve(debrep_2.Edges)
crv_2 = Curve(debrep_3.Edges)
boundary_2 = BoundarySurfaces(Edges=crv)
join_2 = JoinCurves(Curves=crv_2, Preserve=False)
area = Area(Geometry=boundary_2)  # -> Area, Centroid
evalsrf = EvaluateSurface(Surface=boundary_2, Point=area.Centroid)  # -> Point, Normal, UDirection, VDirection, Frame
multiplication = Multiplication(A=evalsrf.Normal, B="0.15")
multiplication_2 = Multiplication(A=evalsrf.Normal, B="0.15")
rev = Reverse(Vector=multiplication_2)
end = EndPoints(Curve=debrep_2.Faces)  # -> Start, End
extr_3 = Extrude(Base=debrep_3.Faces, Direction=multiplication_2)  # -> flatten(Extrusion)
extr_4 = Extrude(Base=debrep_3.Faces, Direction=rev)  # -> flatten(Extrusion)
rev_2 = Reverse(Vector=multiplication)
line = LineSDL(Start=end.Start, Direction=rev_2, Length="0.15")
line_2 = LineSDL(Start=end.Start, Direction=multiplication, Length="0.15")
sunion = SolidUnion(Breps=flatten(extr_4))
sunion_2 = SolidUnion(Breps=flatten(extr_3))
join_3 = JoinCurves(Curves=[line_2, line], Preserve=False)
end_2 = EndPoints(Curve=join_3)  # -> Start, End
scale_nu = ScaleNU(Geometry=[sunion_2, sunion], Plane=PlaneXY(0, 0, 0), ScaleX=1, ScaleY=1, ScaleZ="0.1")  # -> Geometry, Transform
G_2 = ClusterOutput(scale_nu.Geometry)
explode_2 = Explode(Curve=debrep_2.Faces, Recursive=True)  # -> Segments, Vertices
eval_3 = EvaluateLength(Curve=join_3, Length="0.5", Normalized=True)  # -> Point, Tangent, Parameter
vec2pt = Vector2Pt(PointA=eval_3.Point, PointB=end_2.Start, Unitize=False)  # -> Vector, Length
vec2pt_2 = Vector2Pt(PointA=eval_3.Point, PointB=end_2.End, Unitize=False)  # -> Vector, Length
item_3 = ListItem(List=explode_2.Segments, Index=0, Wrap=True)
move_3 = Move(Geometry=item_3, Motion=vec2pt_2.Vector)  # -> Geometry, Transform
move_4 = Move(Geometry=item_3, Motion=vec2pt.Vector)  # -> Geometry, Transform
loft = Loft(
    Curves=[move_3.Geometry, move_4.Geometry],
    Options={Adjust=False, Closed=False, LoftEnds=0, LoftSimp=0, LoftType=0, Rebuild=10, Refit=0.01})
Z_5 = UnitZ(Factor=1)
extr_5 = Extrude(Base=loft, Direction=Z_5)  # -> flatten(Extrusion)
E = ClusterOutput(extr_5)
